# Grasshopper definition 20181005_tim_parentRectangle.gh (Grasshopper 1.0.4)

number_slider = Slider(2, range=0..3)
pt = Point(Point(-13.77485636, -6.934602347, 0))
角度 = Integer(Slider(31, range=0..360))
边号 = Integer([Slider(1, range=0..3), Slider(2, range=0..3)])
位距 = Number(Slider(2.51, range=0..20))
boolean = Boolean([Toggle(True), Toggle(False)])
偏移 = Number(Slider(0, range=0..10))
相位 = Integer(Slider(0, range=0..3))
宽深 = Number([Slider(8.21, range=0..100), Slider(4.42, range=0..100)])
pt_2 = PointOriented(BasePlane=pt, UComponent=0, VComponent=0, WComponent=0)
rad = Radians(Degrees=角度)
lng = ListLength(List=相位)
prot = RotatePlane(Plane=pt_2, Angle=rad)
series = Series(Start=相位, Step=1, Count=3)
mod = Modulus(A=相位, B=2)
addition = Addition(A=相位, B=边号)

# ---- group: 短路判断
gate = StreamGate(Stream=位距, Gate=boolean)  # -> Target0, Target1
mod_2 = Modulus(A=addition, B=2)
item = ListItem(List=宽深, Index=mod_2, Wrap=True)
larger = LargerThan(FirstNumber=gate.Target1, SecondNumber=item)  # -> LargerThan, OrEqualTo
filter = StreamFilter(Gate=larger.LargerThan, Stream0=gate.Target1, Stream1=item)
filter_2 = StreamFilter(Gate=boolean, Stream0=gate.Target0, Stream1=filter)
实位距 = Number(filter_2)

# ----
panel = Panel("""0,1,0
1,0,1""")
pln = Plane(prot)
series_2 = Series(Start=0, Step=1.570796327, Count=4)

# ---- group: 非短路判断
mod_3 = Modulus(A=addition, B=2)  # disabled
item_2 = ListItem(List=宽深, Index=mod_3, Wrap=True)  # disabled
larger_2 = LargerThan(FirstNumber=位距, SecondNumber=item_2)  # -> LargerThan, OrEqualTo; disabled
and = GateAnd(A=larger_2.LargerThan, B=boolean)  # disabled
gate_2 = StreamGate(Stream=位距, Gate=and)  # -> Target0, Target1; disabled
filter_3 = StreamFilter(Gate=and, Stream0=gate_2.Target0, Stream1=item_2)  # disabled
实位距_2 = Number(filter_3)  # disabled

# ----
item_3 = ListItem(List=panel, Index=mod, Wrap=True)
deplane = DeconstructPlane(Plane=pln)  # -> Origin, XAxis, YAxis, ZAxis
Z = UnitZ(Factor=1)
split = TextSplit(Text=item_3, Separators=",")
vrot = Rotate(Vector=deplane.XAxis, Axis=Z, Angle=series_2)
addition_2 = Addition(A=addition, B=1)
vec = Vector(vrot)
item_4 = ListItem(List=vec, Index=series, Wrap=True)
item_5 = ListItem(List=vec, Index=addition, Wrap=True)
vdis = VectorDisplay(Anchor=deplane.Origin, Vector=vrot)  # disabled
item_6 = ListItem(List=宽深, Index=split, Wrap=True)
item_7 = ListItem(List=vec, Index=addition_2, Wrap=True)
amp = Amplitude(Vector=item_4, Amplitude=item_6)
vec_2 = VectorXYZ(XComponent=0, YComponent=0, ZComponent=0)  # -> Vector, Length
panel_2 = Panel(item_6)
amp_2 = Amplitude(Vector=item_7, Amplitude=偏移)
amp_3 = Amplitude(Vector=item_5, Amplitude=实位距)
stack = StackData(Data=vec_2.Vector, Stack=lng)  # -> graft(Data)
ma = MassAddition(Input=amp)  # -> Result, PartialResults
merge = Merge(Data1=stack, Data2=ma.PartialResults)
addition_3 = Addition(A=deplane.Origin, B=merge)
item_8 = ListItem(List=addition_3, Index=边号, Wrap=True)
addition_4 = Addition(A=item_8, B=amp_3)
addition_5 = Addition(A=addition_4, B=amp_2)
位点 = Point(addition_4)
偏移点 = Point(addition_5)
combine = CombineData()  # -> Result, Index
pline = PolyLine(Vertices=addition_3, Closed=True)
