# Grasshopper definition 20181009_tim_ModelImport.gh (Grasshopper 1.0.4)

list = ValueList({"按建筑类型": 0, "按地块编号": 1}, selected="按建筑类型")
int = Integer(Slider(32, range=0..100))
txt = Text("C:\Users\htwt\Desktop\model-demo\01.skp")
int_2 = Integer(list)
pt = Point(Point(-21.43294287, 3.700306281, 0))
python = GhPythonScript(flag=Toggle(False), clear_flag=Toggle(False), filepath=txt, coords=pt, angle=int, layerType=int_2)  # -> out, a; inputs flag: Boolean, clear_flag: Boolean, coords: Point3d, angle: Int32, layerType: Int32
# ---------- python: Python ----------
__author__ = "htwt"
__version__ = "2018.10.10"

import rhinoscriptsyntax as rs
import scriptcontext as sc
import Rhino
import os


def changeLayer():
    return

def importModel(filepath, coords, angle):
    #RootPath = "C:\Users\htwt\Desktop\model-demo"
    #FilePath = os.path.join(RootPath, "01.skp")
    
    rs.Command("_-import " + filepath + " _Enter")
    # select Last object
    sc.doc = Rhino.RhinoDoc.ActiveDoc
    obj_id = rs.LastCreatedObjects()
    #obj_id = rs.SelectedObjects()
    sc.doc = ghdoc
    # changeLayerByName
    # move&rotate
    print(coords)
    ref_arr = [[0, 0], [1, 0]]
    #rotateTar = Point3d(1,0)  # temp
    tar_arr = [coords, rs.PointAdd(coords, [1, 0])]
    rs.OrientObject(obj_id, ref_arr, tar_arr)
    
def clear():
    sc.doc = Rhino.RhinoDoc.ActiveDoc
    objs = rs.AllObjects()
    rs.DeleteObjects(objs)
    sc.doc = ghdoc

def main(flag):
    if flag:
        importModel(filepath, coords, angle)
    if clear_flag:
        clear()

main(flag)

"""
rs.Command( "_-Circle 0,0,0 2 _Enter" )
rs.Command( "_-Point 3,0,0 _Enter" )
rs.Command( "_-Circle 5,0,0 1 _Enter" )

sc.doc = Rhino.RhinoDoc.ActiveDoc
a = str(rs.LastCreatedObjects())
sc.doc = ghdoc
"""
# ---------- end python ----------
