# Grasshopper definition 20181013_tim_PresentSituationDescription.gh (Grasshopper 1.0.4)

位点 = Point()
角度 = Point()
相位 = Point()
宽深 = Point()
道路始末位置 = Point()
data = Data()
data_2 = Data()

建筑类型表 = Text()
职业表 = Text()
各职业不同时段实际场所表 = Text()
实际场所与建筑类型映射表 = Integer()
各职业人数 = Integer()
panel = Panel([职业表, 各职业不同时段实际场所表, 实际场所与建筑类型映射表, 建筑类型表, 各职业人数])
各时刻各建筑类型人员序号 = Integer(panel)

角度_2 = Point()
相位_2 = Point()
panel_2 = Panel([角度_2, 相位_2])
实际角度 = Point(panel_2)
位点_2 = Point(位点)
角度_3 = Point(实际角度)
宽深_2 = Point(宽深)
文件路径 = Text()
模型 = Data()
panel_3 = Panel([位点_2, 角度_3, 宽深_2, 模型, 文件路径])
导入结果 = Data(panel_3)

panel_4 = Panel([位点, 角度, 相位, 宽深])
panel_5 = Panel([道路始末位置, data, data_2])
中心线 = Curve(panel_5)

建筑类型 = Text()
建筑矩形 = Rectangle(panel_4)
panel_6 = Panel([建筑类型, 建筑矩形])
各类型建筑数量 = Integer(panel_6)

panel_7 = Panel("""各地块类型人数
各建筑人数
不同时段人的路径""")
各时刻各建筑类型人数 = Integer(各时刻各建筑类型人员序号)
各类型建筑数量_2 = Integer(各类型建筑数量)
时刻序号 = Integer()
建筑位点 = Point(位点)
panel_8 = Panel([各时刻各建筑类型人数, 各类型建筑数量_2, 时刻序号])

路网 = Curve(中心线)
panel_9 = Panel(路网)
邻接关系 = Integer(panel_9)
路网结点 = Point(panel_9)
邻接距离 = Number(panel_9)

某时刻各建筑类型人员序号 = Integer(panel_8)
panel_10 = Panel(某时刻各建筑类型人员序号)
各时刻建筑人员序号 = Integer(panel_10)
某人员各时刻建筑序号 = Integer(各时刻建筑人员序号)
某人员各时刻建筑序号序 = Integer(某人员各时刻建筑序号)
panel_11 = Panel([某人员各时刻建筑序号序, 建筑位点])
各建筑人数 = Integer()
结束点 = Point(panel_11)
起始点 = Point(panel_11)
现有路网 = Curve(路网)
现有路网结点 = Integer(路网结点)
结点邻接关系 = Integer(邻接关系)
起始点_2 = Point(起始点)
结束点_2 = Point(结束点)
现有路网_2 = Curve(flatten([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]))
panel_12 = Panel([现有路网, 现有路网结点, 结点邻接关系, 起始点_2, 结束点_2])
更新结点邻接关系 = Integer(panel_12)
建筑结点编号1 = Integer(panel_12)
建筑结点编号2 = Integer(panel_12)
现有路网_3 = Curve(现有路网_2)
cluster = Cluster_3()  # -> 起始点_2, 结束点_2
道路建筑节点邻接关系 = Integer(更新结点邻接关系)
建筑结点编号1_2 = Integer(建筑结点编号1)
建筑结点编号2_2 = Integer(建筑结点编号2)
cluster_2 = Cluster_2(路网=现有路网_3)  # -> 路网结点_2, 邻接关系_2, 邻接距离_2

# ---- group: 深度优先算法
结点序号1 = Integer()
邻接关系_2 = Integer()
结点序号2 = Integer()
panel_13 = Panel([邻接关系_2, 结点序号1, 结点序号2])
路径_结点序 = Integer(panel_13)

# ----
pt = Point(Point(3429.203187, 2959.177213, 0))
pt_2 = Point(Point(3127.754649, 1798.202517, 0))
panel_14 = Panel([道路建筑节点邻接关系, 建筑结点编号1_2, 建筑结点编号2_2])
插入结点0_2 = 插入结点02(结点邻接关系=cluster_2.邻接关系_2, 现有路网结点=cluster_2.路网结点_2, 现有路网=现有路网_3, 起始点=cluster.起始点_2, 结束点=cluster.结束点_2)  # -> 更新结点邻接关系_2, 建筑结点编号1_2, 建筑结点编号2_2
出行方式 = Integer()
邻接距离_2 = Number(邻接距离)
动向路径路径_结点序 = Text(panel_14)
动向路径路径_结点序_2 = Text(动向路径路径_结点序)
panel_15 = Panel([出行方式, 邻接距离_2, 动向路径路径_结点序_2])
遍历路径0_2 = 遍历路径02(道路建筑节点邻接关系=插入结点0_2.更新结点邻接关系_2, 建筑结点编号1=插入结点0_2.建筑结点编号1_2, 建筑结点编号2=插入结点0_2.建筑结点编号2_2)
交通时间 = Number(panel_15)
panel_16 = Panel(遍历路径0_2)

# ==== cluster Cluster_2
路网 = ClusterInput()
路网_2 = Curve(路网)
mcx = MultipleCurves(Curves=路网_2)  # -> Points, IndexA, IndexB, ParamA, ParamB
# 生成中线交点
end = EndPoints(Curve=路网_2)  # -> Start, End
# 生成端点
crv = Curve(路网_2)
crv_2 = Curve(路网_2)
cset = CreateSet(List=mcx.Points)  # -> Set, Map
pt = Point([end.Start, end.End])
crv_3 = Curve([crv_2, crv])
cset_2 = CreateSet(List=pt)  # -> Set, Map
去除重合端点 = 去除重合端点(S=cset.Map, L=cset.Map)
# 去除重合端点
cluster = Cluster(L=cset_2.Map)
cull_i = CullIndex(List=mcx.ParamA, Indices=去除重合端点, Wrap=True)  # -> flatten(List)
cull_i_2 = CullIndex(List=mcx.ParamB, Indices=去除重合端点, Wrap=True)  # -> flatten(List)
cull_i_3 = CullIndex(List=mcx.IndexB, Indices=去除重合端点, Wrap=True)  # -> flatten(List)
cull_i_4 = CullIndex(List=mcx.IndexA, Indices=去除重合端点, Wrap=True)  # -> flatten(List)
cull_i_5 = CullIndex(List=crv_3, Indices=cluster, Wrap=True)
端点所在线 = Curve(cull_i_5)
端点 = Point(cset_2.Set)
intersection = SetIntersection(SetA=cset.Set, SetB=端点)
index = ItemIndex(List=端点, Item=intersection)
cull_i_6 = CullIndex(List=端点所在线, Indices=index, Wrap=True)  # -> flatten(List)
cull_i_7 = CullIndex(List=端点, Indices=index, Wrap=True)  # -> flatten(List)
端点所在线_2 = Curve(cull_i_6)
a线的编号 = Integer(cull_i_4)
b线的编号 = Integer(cull_i_3)
端点_2 = Point(cull_i_7)
交点 = Point(cset.Set)
index_2 = ItemIndex(List=路网_2, Item=端点所在线_2)
crv_cp = CurveClosestPoint(Point=端点_2, Curve=端点所在线_2)  # -> Point, Parameter, Distance
端点在曲线上的参量 = Number(crv_cp.Parameter)
在a曲线上参量 = Number([cull_i, 端点在曲线上的参量])
在b曲线上参量 = Number(cull_i_2)
a线的编号_2 = Integer([a线的编号, index_2])
b线的编号_2 = Integer(b线的编号)
交点_2 = Point([交点, 端点_2])
entwine = Entwine(Branch00=a线的编号_2, Branch01=b线的编号_2, FlattenInputs=True)
entwine_2 = Entwine(Branch00=在a曲线上参量, Branch01=在b曲线上参量, FlattenInputs=True)
flip = FlipMatrix(Data=entwine_2)
flip_2 = FlipMatrix(Data=entwine)
端点在曲线上的参量_2 = Number(flip)
所有节点 = Point(交点_2)
lng = ListLength(List=所有节点)
lng_2 = ListLength(List=路网_2)
series = Series(Start=0, Step=1, Count=lng)  # -> flatten(Series)
series_2 = Series(Start=0, Step=1, Count=lng_2)  # -> flatten(Series)
int = Integer(graft(series))
int_2 = Integer(series_2)
data = Data([int, flip_2, 端点在曲线上的参量_2])
panel = Panel("""0
1
3""")
panel_2 = Panel("""0
2
4""")
flip_3 = FlipMatrix(Data=data)
path = DataPath(panel)
path_2 = DataPath(panel_2)
simplify = SimplifyTree(Tree=flip_3, Front=False)
branch = TreeBranch(Tree=simplify, Path=path, MaintainPaths=True)
branch_2 = TreeBranch(Tree=simplify, Path=path_2, MaintainPaths=True)
bang = ExplodeTree(Data=branch)  # -> Branch0, Branch1, Branch2
bang_2 = ExplodeTree(Data=branch_2)  # -> Branch0, Branch1, Branch2
mindex = MemberIndex(Set=bang.Branch1, Member=int_2)  # -> Index, Count
item = ListItem(List=bang.Branch2, Index=mindex.Index, Wrap=True)
mindex_2 = MemberIndex(Set=bang_2.Branch1, Member=int_2)  # -> Index, Count
item_2 = ListItem(List=bang_2.Branch2, Index=mindex_2.Index, Wrap=True)
simplify_2 = SimplifyTree(Tree=item, Front=False)
simplify_3 = SimplifyTree(Tree=mindex.Index, Front=False)
simplify_4 = SimplifyTree(Tree=item_2, Front=False)
simplify_5 = SimplifyTree(Tree=mindex_2.Index, Front=False)
int_3 = Integer(simplify_5)
num = Number(simplify_4)
num_2 = Number(simplify_2)
int_4 = Integer(simplify_3)
data_2 = Data([num_2, num])
data_3 = Data([int_4, int_3])
sort = SortList(Keys=data_2)  # -> Keys, ValuesA
mindex_3 = MemberIndex(Set=sort.Keys, Member=data_2)  # -> Index, Count
pshift = ShiftPaths(Data=mindex_3.Index, Offset=-1)
replace = ReplaceItems(List=data_3, Item=data_3, Indices=pshift, Wrap=False)
每段中线上的点_从头到尾 = Integer(replace)
num_3 = Number(sort.Keys)
lng_3 = ListLength(List=num_3)
lng_4 = ListLength(List=每段中线上的点_从头到尾)
subtraction = Subtraction(A=lng_3, B=1)
subtraction_2 = Subtraction(A=lng_4, B=1)
stack = StackData(Data=2, Stack=lng_3)
stack_2 = StackData(Data=2, Stack=lng_4)
ins = InsertItems(List=subtraction, Item="0", Indices="0", Wrap=True)
ins_2 = InsertItems(List=subtraction_2, Item="0", Indices="0", Wrap=True)
simplify_6 = SimplifyTree(Tree=ins, Front=False)
simplify_7 = SimplifyTree(Tree=ins_2, Front=False)
simplify_8 = SimplifyTree(Tree=stack, Front=False)
simplify_9 = SimplifyTree(Tree=stack_2, Front=False)
# 确立两点关系
# (0；0)
# 第一个是中线标号
replace_2 = ReplaceItems(List=simplify_8, Item=1, Indices=simplify_6, Wrap=False)
# 确立两点关系
# (0；0)
# 第一个是中线标号
replace_3 = ReplaceItems(List=simplify_9, Item=1, Indices=simplify_7, Wrap=False)
stack_3 = StackData(Data=num_3, Stack=replace_2)
stack_4 = StackData(Data=每段中线上的点_从头到尾, Stack=replace_3)
partition = PartitionList(List=stack_3, Size=2)
partition_2 = PartitionList(List=stack_4, Size=2)
simplify_10 = SimplifyTree(Tree=partition, Front=False)
simplify_11 = SimplifyTree(Tree=partition_2, Front=False)
两点关系 = Integer(simplify_11)
item_3 = ListItem(List=simplify_10, Index=0, Wrap=True)
item_4 = ListItem(List=simplify_10, Index=1, Wrap=True)
subtraction_3 = Subtraction(A=item_3, B=item_4)
join = TextJoin(Text=两点关系, Join=",")  # -> flatten(Result)
abs = Absolute(Value=subtraction_3)  # -> flatten(Result)
路网结点 = Point(所有节点)
邻接关系 = Text(join)
邻接距离 = Number(abs)
路网结点_2 = ClusterOutput(路网结点)
邻接关系_2 = ClusterOutput(邻接关系)
邻接距离_2 = ClusterOutput(邻接距离)

# ==== cluster Cluster_3
某人员各时刻建筑序号 = ClusterInput()
建筑位点 = ClusterInput()
某人员各时刻建筑序号_2 = Integer(某人员各时刻建筑序号)
建筑位点_2 = Point(建筑位点)
shift = ShiftList(List=某人员各时刻建筑序号_2, Shift=[-1, 1], Wrap=False)
pshift = ShiftPaths(Data=shift, Offset=1)
flip = FlipMatrix(Data=pshift)
item = ListItem(List=建筑位点_2, Index=flip, Wrap=True)
item_2 = ListItem(List=item, Index=0, Wrap=True)  # -> Item, Item1
起始点 = Point(item_2.Item)
结束点 = Point(item_2.Item1)
起始点_2 = ClusterOutput(起始点)
结束点_2 = ClusterOutput(结束点)

# ==== cluster 插入结点02
现有路网 = ClusterInput()
起始点 = ClusterInput()
结束点 = ClusterInput()
结点邻接关系 = ClusterInput()
现有路网结点 = ClusterInput()
现有路网_2 = Curve(现有路网)
结束点_2 = Point(结束点)
起始点_2 = Point(起始点)
结点邻接关系_2 = Text(结点邻接关系)
现有路网结点_2 = Point(现有路网结点)
crv_cp = CurveClosestPoint(Point=起始点_2, Curve=现有路网_2)  # -> Point, Parameter, Distance
crv_cp_2 = CurveClosestPoint(Point=结束点_2, Curve=现有路网_2)  # -> Point, Parameter, Distance
sort = SortList(Keys=crv_cp.Distance)  # -> Keys, ValuesA
sort_2 = SortList(Keys=crv_cp_2.Distance)  # -> Keys, ValuesA
lng = ListLength(List=现有路网结点_2)
item = ListItem(List=sort.Keys, Index=0, Wrap=True)
item_2 = ListItem(List=sort_2.Keys, Index=0, Wrap=True)
lng_2 = ListLength(List=现有路网结点_2)
addition = Addition(A=lng, B=1)
mindex = MemberIndex(Set=crv_cp.Distance, Member=item)  # -> Index, Count
mindex_2 = MemberIndex(Set=crv_cp_2.Distance, Member=item_2)  # -> Index, Count
start_numbert = Integer(lng_2)
end_numbert = Integer(addition)
item_3 = ListItem(List=结点邻接关系_2, Index=mindex.Index, Wrap=True)
item_4 = ListItem(List=结点邻接关系_2, Index=mindex_2.Index, Wrap=True)
split = TextSplit(Text=item_4, Separators=",")
split_2 = TextSplit(Text=item_3, Separators=",")
item_5 = ListItem(List=split, Index=1, Wrap=True)  # -> flatten(Item)
item_6 = ListItem(List=split_2, Index=0, Wrap=True)  # -> flatten(Item)
item_7 = ListItem(List=split_2, Index=1, Wrap=True)  # -> flatten(Item)
item_8 = ListItem(List=split, Index=0, Wrap=True)  # -> flatten(Item)
panel = Panel([item_6, ",", start_numbert])
panel_2 = Panel([start_numbert, ",", item_7])
panel_3 = Panel([end_numbert, ",", item_8])
panel_4 = Panel([item_8, ",", end_numbert])
join = TextJoin(Text=panel_4)
join_2 = TextJoin(Text=panel_3)
join_3 = TextJoin(Text=panel)
join_4 = TextJoin(Text=panel_2)
panel_5 = Panel([mindex.Index, mindex_2.Index])
panel_6 = Panel([join_3, join_4])
panel_7 = Panel([join, join_2])
cull_i = CullIndex(List=结点邻接关系_2, Indices=panel_5, Wrap=True)
panel_8 = Panel([panel_6, panel_7])
merge = Merge(Data1=flatten(cull_i), Data2=flatten(panel_8))
更新结点邻接关系 = Text(merge)

建筑结点编号1 = Integer(start_numbert)
建筑结点编号2 = Integer(end_numbert)

更新结点邻接关系_2 = ClusterOutput(更新结点邻接关系)
建筑结点编号1_2 = ClusterOutput(建筑结点编号1)
建筑结点编号2_2 = ClusterOutput(建筑结点编号2)

# ==== cluster 遍历路径02
道路建筑节点邻接关系 = ClusterInput()
建筑结点编号2 = ClusterInput()
建筑结点编号1 = ClusterInput()
道路建筑节点邻接关系_2 = Text(道路建筑节点邻接关系)
建筑结点编号1_2 = Integer(建筑结点编号1)
建筑结点编号2_2 = Integer(建筑结点编号2)
path = GhPythonScript(releation=道路建筑节点邻接关系_2, start=建筑结点编号1_2, end=建筑结点编号2_2)  # -> simplify(out), a; inputs releation: list
# ---------- path: Python ----------
__author__ = "河妖"
__version__ = "2018.10.10"

import rhinoscriptsyntax as rs

y = len(releation)
class Node:
    def __init__(self,data):
        self.data = data
        self.next = None

class LinkedList:
    def __init__(self):
        self.head = None
        self.tail = None

    def append(self,data):
        node = Node(data)
        if self.head is None:
            self.head = node
            self.tail = node
        else:
            self.tail.next = node
            self.tail = node

merge = []
for i in range(0,y):
    link_list = LinkedList()
    link_list.append(i)
    merge.append(link_list)

for i in range(0,y):
    for z in range(0,len(releation)):
        a = releation[z].split(',',1)[0]
        b = releation[z].split(',',1)[1]
        if(i == int(a)):
            merge[i].append(int(b))
        elif(i == int(b)):
            merge[i].append(int(a))
        else:
            None

d = {}
for i in range(0,y):
    d[i] = 0
temp = []
anwser = []
def DFS(node,end):
    void = node.head
    if(void.data == end):
        temp.append(end)
        x = ""
        for q in range(0,len(temp)):
            x += str(temp[q])
            x += ","
        x = x[0:len(x)-1]
        print(x)
        anwser.append(temp)
        temp.pop()
    else:
        d[void.data] = 1
        temp.append(void.data)
        w = merge[void.data].head
        while(w != None):
            if(d[w.data] != 1):
                DFS(merge[w.data],end)
            w = w.next
            if(w == None):
                d[temp[-1]] = 0
                temp.pop()
                
DFS(merge[start],end)
# ---------- end path ----------
动向路径路径_结点序 = Text(path.out)
动向路径路径_结点序_2 = ClusterOutput(动向路径路径_结点序)

# ==== cluster Cluster
L = ClusterInput()
cset = CreateSet(List=L)  # -> Set, Map
mindex = MemberIndex(Set=cset.Map, Member=cset.Set)  # -> Index, Count
lng = ListLength(List=mindex.Index)
larger = LargerThan(FirstNumber=lng, SecondNumber=1)  # -> LargerThan, OrEqualTo
cull = CullPattern(List=mindex.Index, CullPattern=larger.LargerThan)
shift = ShiftList(List=cull, Shift=1, Wrap=False)  # -> flatten(List)
L_2 = ClusterOutput(shift)

# ==== cluster 去除重合端点
L = ClusterInput()
S = ClusterInput()
cset = CreateSet(List=L)  # -> Set, Map
mindex = MemberIndex(Set=S, Member=cset.Set)  # -> Index, Count
lng = ListLength(List=mindex.Index)
larger = LargerThan(FirstNumber=lng, SecondNumber=1)  # -> LargerThan, OrEqualTo
cull = CullPattern(List=mindex.Index, CullPattern=larger.LargerThan)  # -> flatten(List)
shift = ShiftList(List=cull, Shift=1, Wrap=False)
L_2 = ClusterOutput(shift)
