# Grasshopper definition 20181002_tim_convertBetweenExcelAndGh.gh (Grasshopper 1.0.4)

是否保留结构 = Boolean(Toggle(False))
excel文件路径 = Text()
工作簿名称 = Text()
python = GhPythonScript(filepath=excel文件路径, booksheet=工作簿名称, isStructed=是否保留结构)  # -> out, a; inputs isStructed: Boolean
# ---------- python: Python ----------
# -*- coding: utf-8 -*-
"""Provides a scripting component.
    依赖xlrd和xlwt, 确认~\Rhino 6\Plug-ins\IronPython\Lib中存在他们
    Inputs:
        x: The x script variable
        y: The y script variable
    Output:
        a: The a output variable"""

__author__ = "chen"
__version__ = "2018.10.02"

import rhinoscriptsyntax as rs
import xlrd
import xlwt
# ---------- end python ----------
