# Grasshopper definition 20181009_tim_testAgain.gh (Grasshopper 1.0.4)

coords = ImportCoordinates(File="C:\Users\htwt\Desktop\test-tim.xls", Separator=",", XIndex=0, YIndex=1, ZIndex=2)

# ----
# 1,把xlrd, xlwt, xlutils三个文件夹已入rhino路径文件夹中，如:D:\Program Files\Rhino 6\Plug-ins\IronPython\Lib
# 3,暂时不支持xlsx
cluster = Cluster(工作簿名称="Sheet1")  # -> out, data
cluster_2 = Cluster_2()

path = FilePath("C:\Users\htwt\Desktop\test.csv")
c_script = CSharpScript()  # -> Out, A
vb = VBScript()  # -> out, A
# ---------- vb: VB ----------
    Dim xlapp = CreateObject("Excel.Application")
    Dim xlbook = xlapp.Workbooks.Open(App.Path & "C:/Users/htwt/Desktop/tim-test.xls")
# ---------- end vb ----------
file = ReadFile(F=path, PerLineParse=False)  # -> C
#   port F: Uri of file to read
# ---------- file: VB line parser ----------
    action = GH_LineParserAction.Include
    Return line

    'Parse the line and return some data that represents the line.
    'If the line cannot be parsed, you can return Nothing and
    'assign a different action.
    'The default implementation is to just return the line itself.
    'If you return types that implement IGH_Goo, this component
    'will work substantially faster.
# ---------- end file ----------
python = GhPythonScript(path=path)  # -> out, contents
# ---------- python: Python ----------
# coding=gbk
#-*- coding:utf-8 -*-
"""Provides a scripting component.
    Inputs:
        x: The x script variable
        y: The y script variable
    Output:
        a: The a output variable"""

__author__ = "htwt"
__version__ = "2018.10.09"

import rhinoscriptsyntax as rs
import codecs
with open(path, 'r') as fp:
    contents = fp.read().decode("utf-16")
    #contents = fp.read()
ghenv.Component.Message = "Total File"
# ---------- end python ----------
split = TextSplit(Text=file, Separators=",")

# ==== cluster Cluster
开始读 = ClusterInput()
xls文件路径 = ClusterInput()
工作簿名称 = ClusterInput()
列序号 = ClusterInput()
起始行号 = ClusterInput()
结束行号 = ClusterInput()
是否保留结构 = ClusterInput()
xls文件路径_2 = Text(xls文件路径)
工作簿名称_2 = Text(工作簿名称)
是否保留结构_2 = Boolean(是否保留结构)
开始读_2 = Boolean(开始读)
结束行号_2 = Integer(结束行号)
起始行号_2 = Integer(起始行号)
列序号_2 = Integer(列序号)
python = GhPythonScript(read=开始读_2, filepath=xls文件路径_2, worksheetname=工作簿名称_2, column=列序号_2, startRow=起始行号_2, endRow=结束行号_2, isStructed=是否保留结构_2)  # -> out, data; inputs isStructed: Boolean
# ---------- python: Python ----------
# -*- coding: utf-8 -*-
"""Provides a scripting component.
    依赖xlrd和xlwt, 确认~\Rhino 6\Plug-ins\IronPython\Lib中存在他们
    Inputs:
        read: 
        filepath: 
        worksheetname:
        column:
        startRow:
        endRow:
        isStructed: 是否保留结构
    Output:
        Data: The a output variable"""

__author__ = "chen"
__version__ = "2018.10.02"

import rhinoscriptsyntax as rs
from xlrd import open_workbook
from xlwt import Workbook


def main():
    data = []
    input_file = filepath
    input_workbook = open_workbook(input_file)
    
    with open_workbook(input_file) as workbook:
        # if worksheet.nrows < startRow or worksheet.nrows < endRow or colum    边界条件
        worksheet = workbook.sheet_by_name(worksheetname)
        for row_index in range(startRow, endRow+1):
            value = worksheet.cell_value(row_index-1, column-1)
            if (not isStructed and value == ''):continue;
            data.append(value)
    return data

if (read):
    data = main()
# ---------- end python ----------
data = ClusterOutput(python.data)
out = ClusterOutput(python.out)

# ==== cluster Cluster_2
开始写 = ClusterInput()
表名 = ClusterInput()
数据 = ClusterInput()
工作簿名称 = ClusterInput()
列序号 = ClusterInput()
起始行 = ClusterInput()
是否保留结构 = ClusterInput()
存在文件路径 = ClusterInput()
开始写_2 = Boolean(开始写)
存在文件路径_2 = Text(存在文件路径)
表名_2 = Text(表名)
数据_2 = Text(数据)
工作簿名称_2 = Text(工作簿名称)
列序号_2 = Integer(列序号)
起始行_2 = Integer(起始行)
是否保留结构_2 = Boolean(是否保留结构)
python = GhPythonScript(
    Write=开始写_2,
    FilePath=存在文件路径_2,
    Table=表名_2,
    Data=数据_2,
    WorkSheetName=工作簿名称_2,
    Column=列序号_2,
    StartRow=起始行_2,
    IsStructed=是否保留结构_2)  # -> out; inputs Data: list
# ---------- python: Python ----------
# -*- coding: utf-8 -*-
"""Provides a scripting component.
    在已经存在的excel中写入
    依赖xlrd和xlutils, 确认~\Rhino 6\Plug-ins\IronPython\Lib中存在他们
    Inputs:
        Write: 
        Table:
        Data:
        FilepPath: 
        WorkSheetName:
        Column:
        StartRow:
        IsStructed: 是否保留结构
    Output:
        out: The a output variable"""

__author__ = "mituh"
__version__ = "2018.10.02"

import rhinoscriptsyntax as rs
from xlrd import open_workbook
#from xlwt import Workbook
from xlutils.copy import copy

def find_sheet_index(sheetName, rbook):
    sheet_i = 0
    names = rbook.sheet_names()
    for i in range(len(names)):
        if (names[i] == sheetName):
            sheet_i = i
            return i
    return -1

def main():
    rbook = open_workbook(FilePath)
    workbook = copy(rbook)
    sheet_i = find_sheet_index(WorkSheetName, rbook)
    if (sheet_i == -1):
        print('Error')
        return
    worksheet = workbook.get_sheet(sheet_i)
    worksheet.write(StartRow-1, Column-1, Table)
    DataStartRow = StartRow + 1
    i = DataStartRow
    for row_index in range(DataStartRow, DataStartRow+len(Data)):
        value = Data[row_index-DataStartRow]
        if (not IsStructed and value == ''):continue;
        worksheet.write(i-1, Column-1, value)
        i+=1
    workbook.save(FilePath)
    print("Ok")

if (Write):
    main()
# ---------- end python ----------
out = ClusterOutput(python)
